vi "DC Removal.gvi"   [LabVIEW Communications System Design Software 2.0.1]
inputs:
  "Input Signal": c128[]
outputs:
  "Output Signal": f64[]
diagram:
  Complex To Real Imaginary(x + iy=$"Input Signal") -> (x=w1)
  Array Max And Min(array=w1) -> (max value=w2, min value=w3)
  Subtract(x=w2, y=w3) -> w4
  Divide(x=w4, y=2) -> w5
  Add(w5, w3) -> w6
  Subtract(x=w1, y=w6) -> w7
  $"Output Signal" <- w7
