vi "Extract Frame.gvi"   [LabVIEW Communications System Design Software 2.0.1]
inputs:
  "Input signal samples": c128[]
  "Search Start Index": i32
  "Samples/Symbol": i32
outputs:
  "Output Thresholded Packet": f64[]
  "First Frame End Index": i32
  "First Frame Start Index": i32
panel indicators:
  "Graph": f64[]
  "Graph_2": f64[]
diagram:
  call "DC Removal.gvi"(Input Signal=$"Input signal samples") -> (Output Signal=w1)
  call "Thresholding.gvi"(DC Removed Samples=w1) -> (Output Thresholded Samples=w2)
  $Graph <- w2
  call "Frame Markers.gvi"(Input Symbols=w2, Samples/Symbol=$"Samples/Symbol") -> (Frame Marked Array=w3)
  call "Extract First Frame Indices.gvi"(Frame Marker=w3, Search Start Index=$"Search Start Index") -> (First Frame Start Index=w4, Frame Length=w5, First Frame End Index=w6)
  $"First Frame Start Index" <- w4
  Array Subset(array=w2, index0=w4, length0=w5) -> w7
  $"Output Thresholded Packet" <- w7
  $"First Frame End Index" <- w6
