vi "Frame Markers.gvi"   [LabVIEW Communications System Design Software 2.0.1]
inputs:
  "Input Symbols": i8[]
  "Samples/Symbol": i32
outputs:
  "Frame Marked Array": i16[]
diagram:
  Multiply($"Samples/Symbol", 2) -> w1
  s1 = 1  # shift register
  s2 = 0  # shift register
  for {
    w2 = each element of $"Input Symbols"
    Increment(x=s2) -> w4
    Is Equal(x=w2, y=s1) -> w5
    Select(s=w5, t=w4, f=0) -> w6
    Is Less(x=w6, y=w1) -> w7
    Boolean To Integer(Boolean=w7) -> (0, 1=w8)
    append w8 to w3
    next s1 = w2
    next s2 = w6
  }
  $"Frame Marked Array" <- w3
