vi "Frame Sync Mod.gvi"   [LabVIEW Communications System Design Software 2.0.1]
inputs:
  "Samples In": i8[]
  "Samples/Symbol": i32
  "Sync Sequence Threshold": i32 = 26
outputs:
  "Samples Out": i8[]
  "Sequence found ?": bool
  "Correlation Value": f64
panel indicators:
  "Graph": f64[]
uses:
  NI::Analysis::Resampling::Upsample (DBL).gvi
  NI::Analysis::Operations::1D Cross Correlation (DBL).gvi
  NI::Analysis::Resampling::Decimate (single shot, DBL).gvi
diagram:
  Divide(x=$"Samples/Symbol", y=2) -> w1
  call "Generate Sync Bits.gvi"() -> (Sync Bits=w2)
  call "Manchester Coding.gvi"(Input Bits=w2) -> (Output Bits=w3)
  call "Upsample (DBL).gvi"(input array=w3, upsampling factor=w1) -> (upsampled array=w4)
  for {
    w5 = each element of w4
    case (w5) {
      frame 0, Default {
        w7 = -1
      }
      frame 1 {
        w7 = 1
      }
    }
    append w7 to w6
  }
  call "1D Cross Correlation (DBL).gvi"(x=w6, y=$"Samples In") -> (Rxy=w8)
  Absolute Value(x=w8) -> w9
  $Graph <- w9
  Array Max And Min(array=w9) -> (max index(es)=w10, max value=w11)
  $"Correlation Value" <- w11
  Array Size(array=w6) -> (size(s)=w12)
  Increment(x=w10) -> w13
  Subtract(x=w13, y=w12) -> w14
  Array Subset(array=$"Samples In", index0=w14) -> w15
  # Manchester Decoding
  call "Decimate (single shot, DBL).gvi"(input array=w15, decimating factor=w1) -> (decimated array=w16)
  $"Samples Out" <- w16
  Is Greater(x=w11, y=$"Sync Sequence Threshold") -> w17
  $"Sequence found ?" <- w17
