vi "Function.gvi"   [LabVIEW Communications System Design Software 2.0.1]
panel controls:
  "n": i32
  "stop": bool
panel indicators:
  "Graph": i16[][]
  "Array": i16[]
diagram:
  while {
    w1 = [[1, 1, 1, 0, 0, 0, 0, 0, 1, 1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], [1, 0, 0, 1, 0, 1, 0, 0, 0, 0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]]
    Array Index(array=w1) -> (out0[_, _]=w2)
    Array Index(array=w1) -> (out0[1, _]=w3)
    Rotate 1D Array(array=w3, n=$n) -> (array (last n elements first)=w4)
    Build Array(w2, w4) -> w5
    $Graph <- w5
    stop if $stop
  }
  $Array <- w4
