vi "Function_3.gvi"   [LabVIEW Communications System Design Software 2.0.1]
panel controls:
  "Capture 7": f64[] = [1, 1, 1, 1, 1, -1, -1, -1, -1, -1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]
  "Capture 8": f64[] = [1, 1, 1, 1, 1, -1, -1, -1, -1, -1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]
panel indicators:
  "size(s)": i32
  "size(s)_2": i32
  "Graph": f64[]
  "max index(es)": i32
uses:
  NI::Analysis::Operations::1D Cross Correlation (DBL).gvi
diagram:
  # Real
  # Ideal
  call "1D Cross Correlation (DBL).gvi"(x=$"Capture 7", y=$"Capture 8") -> (Rxy=w1)
  Absolute Value(x=w1) -> w2
  $Graph <- w2
  Array Max And Min(array=w2) -> (max index(es)=w3)
  $"max index(es)" <- w3
  Array Size(array=$"Capture 7") -> (size(s)=w4)
  $"size(s)" <- w4
  Array Size(array=$"Capture 8") -> (size(s)=w5)
  $"size(s)_2" <- w5
