vi "Function_4.gvi"   [LabVIEW Communications System Design Software 2.0.1]
panel indicators:
  "Data Bits Out": i8[]
  "Data Bits Out_2": i8[]
diagram:
  call "String to bits.gvi"(User Input="¤26¶7") -> (Data Bits Out=w1)
  $"Data Bits Out" <- w1
  call "String to bits.gvi"(User Input="Hello World") -> (Data Bits Out=w2)
  $"Data Bits Out_2" <- w2
