vi "Manchester Decoding.gvi"   [LabVIEW Communications System Design Software 2.0.1]
inputs:
  "Bits In": i8[]
outputs:
  "Bits Out": u32[]
panel indicators:
  "size(s)": i32
  "size(s)_2": i32
  "Array": i32[]
diagram:
  Array Size(array=$"Bits In") -> (size(s)=w1)
  $"size(s)" <- w1
  s1 = 0  # shift register
  for (iteration -> i1) {
    w2 = each element of $"Bits In"
    Build Array(w2, s1) -> w5
    Increment(x=i1) -> w6
    Quotient And Remainder(x=w6, y=2) -> (x-y*floor(x/y)=w7)
    case (w7) {
      frame 0, Default {
        Is Equal(x=w5, y=[1, 1]) -> w11
        Boolean Array To Number(Boolean array=w11) -> (number=w12)
        case (w12) {
          frame 0, 3, Default {
            w9 = 0
            w8 = FALSE
          }
          frame 1, 2 {
            w9 = w12
            w8 = TRUE
          }
        }
        Is Equal(x=w8, y=FALSE) -> w10
      }
      frame 1 {
        w8 = FALSE
        w9 = 0
        w10 = FALSE
      }
    }
    append w9 to w3 if w8
    append i1 to w4 if w10
    next s1 = w2
  }
  Subtract(x=w3, y=1) -> w13
  $"Bits Out" <- w13
  Array Size(array=w13) -> (size(s)=w14)
  $"size(s)_2" <- w14
  $Array <- w4
