vi "Modulation (OOK).gvi"   [LabVIEW Communications System Design Software 2.0.1]
inputs:
  "Amplitude": f64
  "Bits In": i8[]
outputs:
  "Complex Samples": c128[]
diagram:
  Is Not Equal To 0(x=$"Bits In") -> w1
  for {
    w2 = each element of w1
    Negate(x=$Amplitude) -> w4
    Select(s=w2, t=$Amplitude, f=w4) -> w5
    append w5 to w3
  }
  Array Size(array=w3) -> (size(s)=w6)
  Initialize Array(element=0, size=w6) -> w7
  Real And Imaginary To Complex(x=w3, y=w7) -> w8
  $"Complex Samples" <- w8
