vi "Thresholding.gvi"   [LabVIEW Communications System Design Software 2.0.1]
inputs:
  "DC Removed Samples": f64[]
outputs:
  "Output Thresholded Samples": f64[]
diagram:
  Is Greater(x=$"DC Removed Samples", y=0) -> w1
  Boolean To Integer(Boolean=w1) -> (0, 1=w2)
  Subtract(x=w2, y=0.5) -> w3
  Multiply(w3, 2) -> w4
  $"Output Thresholded Samples" <- w4
