vi "Tuning Check.gvi"   [LabVIEW Communications System Design Software 2.0.1]
panel controls:
  "index": i32
  "stop": bool
  "n": i32 = 2
panel indicators:
  "size(s)": i32
  "String Out": string
  "size(s)_2": i32
diagram:
  # Mary had a little lamb
  while {
    w1 = [[0, 0, 0, 0], [0, 0, 1, 0], [0, 0, 1, 0], [0, 0, 1, 0], [0, 0, 1, 0], [0, 0, 1, 0], [0, 0, 1, 0], [0, 0, 1, 0], [0, 0, 1, 1], [0, 0, 1, 1]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]
    Array Index(array=w1) -> (out0[_, 0]=w2)
    Split 1D Array(array=w2, index=148) -> (first subarray=w3)
    Array Size(array=w3) -> (size(s)=w4)
    $"size(s)" <- w4
    Insert Into Array(inArray=[0, 0, 0, 0, 0, 0, 0, 1, 1, 1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], new=[0, 0]) -> w5
    Rotate 1D Array(array=w5, n=$n) -> (array (last n elements first)=w6)
    Split 1D Array(array=w6, index=52) -> (second subarray=w7)
    Is Equal To 0(x=w7) -> w8
    Boolean To Integer(Boolean=w8) -> (0, 1=w9)
    call "Bits to String.gvi"(Bits In=w9) -> (String Out=w10)
    $"String Out" <- w10
    Array Index(array=w1)
    Array Size(array=w7) -> (size(s)=w11)
    $"size(s)_2" <- w11
    # Hello World
    # Shubham
    stop if $stop
  }
